# Grasshopper definition fishing-lure.gh (Grasshopper 0.9.80)

top = Geometry(<curve referenced from the Rhino model>)
front = Geometry(<curve referenced from the Rhino model>)
slits = Geometry([<brep referenced from the Rhino model> x2])
boundary = BoundarySurfaces(Edges=top)
boundary_2 = BoundarySurfaces(Edges=front)
Y = UnitY(Factor=Slider(30, range=0..100))
extr = Extrude(Base=boundary_2, Direction=Y)
Z = UnitZ(Factor=Slider(30, range=0..100))
extr_2 = Extrude(Base=boundary, Direction=Z)
sint = SolidIntersection(BrepsA=extr_2, BrepsB=extr)
solid_lure = Geometry(sint)
sdiff = SolidDifference(BrepsA=solid_lure, BrepsB=slits)
